# Grasshopper definition main.ghx (Grasshopper 1.0.7)
# plug-ins: Human, Shortest Walk in Gh, MeshEdit Components, Arachne, Heteroptera, Anemone

number_slider = Slider(10, range=0..10)
rectangle = Rectangle(Plane=PlaneXY(0, 0, 0), XSize=number_slider, YSize=number_slider, Radius=0)  # -> Rectangle, Length
number_slider_2 = Slider(10, range=0..10)
number_slider_3 = Slider(10, range=0..10)
rectangular_array = RectangularArray(Geometry=rectangle.Rectangle, Cell=rectangle.Rectangle, XCount=number_slider_2, YCount=number_slider_3)  # -> Geometry, Transform

random = Random(Range=Domain(0, 1), Number=Slider(10, range=0..10), Seed=2)
list_length = ListLength(List=rectangular_array.Geometry)  # -> expr("x-1", Length)
remap_numbers = RemapNumbers(Value=random, Source=Domain(0, 1), Target=list_length)  # -> Mapped, Clipped
integer = Integer(remap_numbers.Mapped)
custom_preview_lineweights = CustomPreviewLineweights(Geometry=rectangular_array.Geometry, Shader=ColourSwatch(SwatchColor=RGB(8, 0, 255)), Absolute=False)
list_item = ListItem(List=rectangular_array.Geometry, Index=integer, Wrap=False)
surface = Surface(list_item)
surface_2 = Surface(rectangular_array.Geometry)
area = Area(Geometry=surface_2)
custom_preview = CustomPreview(Geometry=surface, Material=ColourSwatch(SwatchColor=RGB(8, 0, 255)))
mesh_frompoints = MeshFromPoints(Points=area, UDirection=number_slider_2, VDirection=number_slider_3)
geometry = Geometry(rectangular_array.Geometry)
area_2 = Area(Geometry=list_item)
cull_index = CullIndex(List=geometry, Indices=integer, Wrap=True)
list_length_2 = ListLength(List=area_2)

average = Average(Input=random)
list_length_3 = ListLength(List=cull_index)  # -> expr("x-1", Length)
remap_numbers_2 = RemapNumbers(Value=average, Source=Domain(0, 1), Target=list_length_3)  # -> Mapped, Clipped
integer_2 = Integer(remap_numbers_2.Mapped)

loop_start = LoopStart(Repeat=list_length_2)  # -> port, Counter, Data
shortest_walk = ShortestWalk()  # -> ShortestWalk, Succession, Direction, Length
shortest_route = ShortestRoute()  # -> Nodes, Segments, Cost
list_item_2 = ListItem(List=geometry, Index=integer_2, Wrap=True)
area_3 = Area(Geometry=list_item_2)
surface_3 = Surface(list_item_2)
deconstruct_mesh = DeconstructMesh(Mesh=mesh_frompoints)  # -> Vertices, Faces, Colours, Normals
closest_point = ClosestPoint(Point=area_3, Cloud=deconstruct_mesh.Vertices)  # -> ClosestPoint, CPIndex, Distance
fast_loop_start = FastLoopStart(Iterations=list_length_2, Mesh=mesh_frompoints, Eggs=area_2, From=closest_point.ClosestPoint)  # -> port, Counter, Data, Data_2, Data_3, Data_4
mesh_to_graph = MeshToGraph(Mesh=fast_loop_start.Data)
panel = Panel(fast_loop_start.Counter)
point = Point(fast_loop_start.Data_3)
deconstruct_graph = DeconstructGraph(Graph=mesh_to_graph)  # -> Vertices, Edges, Geo
closest_point_2 = ClosestPoint(Point=point, Cloud=deconstruct_graph.Vertices)  # -> ClosestPoint, CPIndex, Distance
closest_point_3 = ClosestPoint(Point=fast_loop_start.Data_2, Cloud=deconstruct_graph.Vertices)  # -> ClosestPoint, CPIndex, Distance
cull_mesh_vertex = CullMeshVertex(mesh=fast_loop_start.Data, point=point)
shortest_path = ShortestPath(Graph=mesh_to_graph, Start=closest_point_2.CPIndex, End=closest_point_3.CPIndex)  # -> simplify(IndexList)
list_item_3 = ListItem(List=deconstruct_graph.Vertices, Index=shortest_path, Wrap=True)
polyline = PolyLine(Vertices=list_item_3, Closed=False)
custom_preview_2 = CustomPreview(Geometry=surface_3, Material=ColourSwatch(SwatchColor=RGB(255, 0, 0)))
curve = Curve(flatten(polyline))
length = Length(Curve=curve)
sort_list = SortList(Keys=length, ValuesA=curve)  # -> Keys, ValuesA
list_item_4 = ListItem(List=sort_list.ValuesA, Index=0, Wrap=True)
point_2 = Point(fast_loop_start.Data_2)
end_points = EndPoints(Curve=list_item_4)  # -> Start, End
closest_point_4 = ClosestPoint(Point=end_points.End, Cloud=point_2)  # -> ClosestPoint, CPIndex, Distance
cull_index_2 = CullIndex(List=point_2, Indices=closest_point_4.CPIndex, Wrap=True)
fast_loop_end = FastLoopEnd(
    port=fast_loop_start.port,
    Exit=False,
    Data=cull_mesh_vertex,
    Data_2=cull_index_2,
    Data_3=end_points.End,
    Data_4=list_item_4,
    RecordData=True,
    TimeOutVal=200)  # -> Mesh, Eggs, From, Path
curve_2 = Curve(flatten(fast_loop_end.Path))
divide_length = DivideLength(Curve=curve_2, Length="10")  # -> Points, Tangents, Parameters
closest_point_5 = ClosestPoint(Point=divide_length.Points, Cloud=area)  # -> ClosestPoint, CPIndex, Distance
discontinuity = Discontinuity(Curve=curve_2, Level=1)  # -> Points, Parameters
list_item_5 = ListItem(List=surface_2, Index=closest_point_5.CPIndex, Wrap=True)
split_list = SplitList(List=curve_2, Index=Slider(3, range=0..100))  # -> ListA, ListB
tree_branch = TreeBranch(Tree=simplify(list_item_5), Path=Slider(4, range=0..10), MaintainPaths=True)
panel_2 = Panel(fast_loop_end.Path)
surface_4 = Surface(split_list.ListA)

# ==== cluster CullMeshVertex
mesh = ClusterInput()
mesh_2 = Mesh(mesh)
deconstruct_mesh = DeconstructMesh(Mesh=mesh_2)  # -> Vertices, Faces, Colours, Normals
point = ClusterInput()
closest_point = ClosestPoint(Point=point, Cloud=deconstruct_mesh.Vertices)  # -> ClosestPoint, CPIndex, Distance
delete_vertices = DeleteVertices(Mesh=mesh_2, Indices=closest_point.CPIndex, Shrink=False)
mesh_3 = ClusterOutput(delete_vertices)
